# Grasshopper definition gradient_linear_stepped.gh (Grasshopper 1.0.7)
# plug-ins: ghgl

pt = Point(Point(-17.43392449, 6.685366709, 0))
pt_2 = Point(Point(21.02465149, -9.189426324, 0))
ln = Line(StartPoint=pt, EndPoint=pt_2)
# Linear Gradient with Steps
divide = DivideCurve(Curve=ln, Count=10, Kinks=False)  # -> Points, Tangents, Parameters
gradient = Gradient(
    LowerLimit=0,
    UpperLimit=1,
    Parameter=divide.Parameters,
    stops=[0: RGB(234, 38, 0), 0.25: RGB(234, 126, 0), 0.558: RGB(254, 244, 84), 0.75: RGB(173, 203, 249), 1: RGB(75, 107, 169)])
brep = Brep([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])
linear_gradient_steps = GLMeshShader(
    M=brep,
    Colors_10=gradient,
    StartPoint=pt,
    EndPoint=pt_2,
    Blend=Toggle(True),
    ScreenSpace=Toggle(False),
    DepthTestingEnabled=True,
    DepthWritingEnabled=True,
    DrawMode=4,
    FragmentShader="""#version 330

uniform vec4 colors[10];
uniform bool blend;

in  float lineT;
out vec4 fragment_color;

void main()
{
  float t = clamp(lineT*10, 0.0, 9.0);
  if(blend)
    fragment_color = mix(colors[int(t)], colors[int(t+1.0)], t-floor(t));
  else
    fragment_color = colors[int(t)];
}""",
    GLShader=(0, 1, 0),
    PreviewSortOrder=5,
    VertexShader="""#version 330

layout(location = 0) in vec3 _meshVertex;

uniform mat4 _worldToClip;
uniform mat4 _worldToScreen;
uniform vec3 startPoint;
uniform vec3 endPoint;
uniform bool screenSpace;

out float lineT;

// return normalized parameter for closest point to a line
float ClosestPointToLineParameter(in vec3 point, in vec3 lineStart, in vec3 lineEnd) {
  vec3 direction = normalize(lineEnd - lineStart);
  vec3 v = point - lineStart;
  float d = dot(direction, v);
  return d / length(lineEnd-lineStart);
}

void main() 
{
  if(screenSpace) {
    vec4 screen = _worldToScreen * vec4(_meshVertex, 1.0);
    vec4 screenStart = _worldToScreen * vec4(startPoint, 1.0);
    vec4 screenEnd = _worldToScreen * vec4(endPoint, 1.0);
    lineT = ClosestPointToLineParameter(vec3(screen.xy,0.0), vec3(screenStart.xy,0), vec3(screenEnd.xy,0.0));
  }
  else
    lineT = ClosestPointToLineParameter(_meshVertex, startPoint, endPoint);
  gl_Position = _worldToClip * vec4(_meshVertex,1.0);
}""",
    glLineWidth=3,
    glPointSize=8)
